# Grasshopper definition columns workflow.ghx (Grasshopper 1.0.8)
# plug-ins: Speckle 2

# ---- group: RH_IN:Send
txt = Text()

# ----
panel = Panel("https://macad.speckle.xyz/projects/af5d09c237/models/0aa2d6f0aa")
synchronous_receiver = SynchronousReceiver(
    Stream=panel,
    AutoReceive=False,
    ReceivedObjectId="696ed7f514c0cd036ac3873a5d1df7f9",
    StreamWrapper="https://macad.speckle.xyz/projects/af5d09c237/models/0aa2d6f0aa",
    selectedKitName="Objects")  # -> Data, Info
receive = Receive(
    Stream=panel,
    AutoReceive=False,
    CurrentComponentState="up_to_date",
    ExpandOutput=True,
    LastInfoMessage="ERVA Hofi @ 03/21/2025 22:37:18: Pushed 50 elements from Grasshopper. (id:88e91b94e1)",
    ReceiveOnOpen=False,
    ReceivedCommitId="88e91b94e1",
    StreamWrapper="https://macad.speckle.xyz/projects/af5d09c237/models/floorplates_v1",
    selectedKitName="Objects")  # -> Info, Data
surface = Surface(graft(receive.Data))
radius_bottom = Slider(26, range=10..30)
of_columns_main_beams = Slider(10, range=0..30)
radius_top = Slider(16, range=10..20)
is_planar = IsPlanar(Surface=surface, Interior=True)  # -> Planar, Plane
project = Project(Geometry=surface, Plane=is_planar.Plane)  # -> Geometry, Transform
area = Area(Geometry=project.Geometry)  # -> Area, graft(Centroid)
# Towers Structural System
list_item = ListItem(List=flatten(area.Centroid), Index=0, Wrap=True)  # -> Item1, Item
circle = Circle(Plane=list_item.Item1, Radius=radius_top)
circle_2 = Circle(Plane=list_item.Item, Radius=radius_bottom)
divide_curve = DivideCurve(Curve=circle, Count=of_columns_main_beams, Kinks=False)  # -> Points, Tangents, Parameters
divide_curve_2 = DivideCurve(Curve=circle_2, Count=of_columns_main_beams, Kinks=False)  # -> Points, Tangents, Parameters
line = Line(StartPoint=divide_curve.Points, EndPoint=divide_curve_2.Points)
surface_2 = Surface(flatten(surface))
panel_2 = Panel("""0
-1""")
cull_index = CullIndex(List=surface_2, Indices=panel_2, Wrap=True)  # -> graft(List)
split_with_breps = SplitWithBreps(Curve=line, Brep=flatten(cull_index))  # -> Curve, Points
panel_3 = Panel(line)
flip_matrix = FlipMatrix(Data=split_with_breps.Curve)
item = ListItem(List=flatten(split_with_breps.Curve), Index=0, Wrap=True)
len = Length(Curve=item)
curve = Curve(flip_matrix)
series = Series(Start="1", Step=1, Count="47")
panel_4 = Panel(len)
panel_5 = Panel(curve)
division = Division(A=len, B="500")
eval = Evaluate(F="3*((2+(N-2)*0.7)/N)", N=series)
ma = MassAddition(Input=eval)  # -> Result, PartialResults
panel_6 = Panel(division)
multiplication = Multiplication(A=division, B="1000")
total_load_kn = Panel(ma.Result)
sum_of_kn_floor = Panel(ma.PartialResults)
kn_floor = Panel(eval)
panel_7 = Panel(sum_of_kn_floor)
multiplication_2 = Multiplication(A=panel_7, B="10000")
expression = Expression(P=multiplication_2, Expression="Sqrt(P / (10^7))")
panel_8 = Panel(expression)
len_2 = Length(Curve=curve)
item_2 = ListItem(List=len_2, Index=0, Wrap=True)
multiplication_3 = Multiplication(A=panel_8, B=Slider(1.5, range=0..10))
rectangle = Rectangle(Plane=curve, XSize=graft(multiplication_3), YSize=graft(multiplication_3), Radius=0)  # -> Rectangle, Length
neg = Negative(Value=item_2)
num = Number(multiplication_2)
multiplication_4 = Multiplication(A=multiplication_3, B="100")
srf = Surface(rectangle.Rectangle)
Z = UnitZ(Factor=neg)
expression_2 = Expression(P=num, L=multiplication_4, b=multiplication_3, E="20e9", Expression="(P * L) / (b^2 * E)")
panel_9 = Panel(multiplication_3)
extr = Extrude(Base=srf, Direction=Z)
panel_10 = Panel(expression_2)
multiplication_5 = Multiplication(A=panel_10, B="1000")
panel_11 = Panel(multiplication_5)
panel_12 = Panel(multiplication)
panel_13 = Panel(multiplication)
item_3 = ListItem(List=panel_11, Index="-1", Wrap=True)

# ---- group: Displacement NO.
panel_14 = Panel(item_3)

# ----
panel_15 = Panel(multiplication)
larger = LargerThan(FirstNumber=panel_14, SecondNumber=panel_15)  # -> LargerThan, OrEqualTo
panel_16 = Panel(larger.OrEqualTo)
bool = Boolean(panel_16)
num_2 = Number(multiplication_2)
panel_17 = Panel(num_2)
panel_18 = Panel("https://macad.speckle.xyz/projects/7f5a70ef59/models/fa4b5e0e3d")
panel_19 = Panel("https://macad.speckle.xyz/projects/7f5a70ef59/models/fa4b5e0e3d")
receive_2 = Receive(
    Stream=panel_19,
    AutoReceive=True,
    CurrentComponentState="up_to_date",
    ExpandOutput=True,
    LastInfoMessage="ERVA Hofi @ 03/23/2025 00:18:06: Pushed 176324 elements from Grasshopper. (id:67a9b2b9fe)",
    ReceiveOnOpen=False,
    ReceivedCommitId="67a9b2b9fe",
    StreamWrapper="https://macad.speckle.xyz/projects/7f5a70ef59/models/structure 02",
    selectedKitName="Objects")  # -> Info, Data
dso = DeconstructSpeckleObject(SpeckleObject=receive_2.Data, selectedKitName="Objects")  # -> Columns, ColumnsCurves, CrossSection, Loads
panel_20 = Panel(dso.Columns)
panel_21 = Panel(dso.Loads)
dso_2 = DeconstructSpeckleObject(SpeckleObject=dso.CrossSection, selectedKitName="Objects")
dso_3 = DeconstructSpeckleObject(SpeckleObject=dso.ColumnsCurves, selectedKitName="Objects")
num_3 = Number(dso.Loads)
panel_22 = Panel(num_3)
crv = Curve(dso_3)
panel_23 = Panel(crv)
num_4 = Number(dso.Loads)
crv_2 = Curve(dso_2)
area_2 = Area(Geometry=crv_2)  # -> Area, Centroid
panel_24 = Panel(area_2.Area)
scale = Scale(Geometry=crv_2, Center=area_2.Centroid, Factor=Slider(1.1, range=0..10))  # -> Geometry, Transform
srf_2 = Surface(scale.Geometry)
area_3 = Area(Geometry=scale.Geometry)  # -> Area, Centroid
expression_3 = Expression(x=area_3.Area, Expression="sqrt(x)")
panel_25 = Panel(expression_3)
item_4 = ListItem(List=flatten(panel_25), Index="1", Wrap=True)
panel_26 = Panel(item_4)
multiplication_6 = Multiplication(A=expression_3, B=Slider(1, range=0..10))
multiplication_7 = Multiplication(A=multiplication_6, B="100")
rectangle_2 = Rectangle(Plane=crv, XSize=graft(panel_26), YSize=graft(panel_26), Radius=0)  # -> Rectangle, Length
srf_3 = Surface(rectangle_2.Rectangle)
expression_4 = Expression(P=num_4, L=multiplication_7, b=multiplication_6, E="20e9", Expression="(P * L) / (b^2 * E)")
panel_27 = Panel(multiplication_6)
extrcrv = ExtrudeAlong(Base=srf_3, Curve=crv)
extrcrv_2 = ExtrudeAlong(Base=srf_2, Curve=crv)
volume = Volume(Geometry=extrcrv)  # -> Volume, Centroid
panel_28 = Panel(expression_4)
panel_29 = Panel(area_3.Area)
volume_2 = Volume(Geometry=extrcrv_2)  # -> Volume, Centroid
panel_30 = Panel(volume.Volume)
ma_2 = MassAddition(Input=flatten(volume.Volume))  # -> Result, PartialResults
ma_3 = MassAddition(Input=flatten(volume_2.Volume))  # -> Result, PartialResults
panel_31 = Panel(volume_2.Volume)
panel_32 = Panel(ma_2.Result)
panel_33 = Panel(ma_3.Result)
multiplication_8 = Multiplication(A=panel_28, B="1000")
panel_34 = Panel(multiplication_8)
item_5 = ListItem(List=flatten(panel_34), Index="-1", Wrap=True)
division_2 = Division(A=panel_33, B=panel_32)
panel_35 = Panel(item_5)
panel_36 = Panel(division_2)
larger_2 = LargerThan(FirstNumber=panel_35, SecondNumber=panel_12)  # -> LargerThan, OrEqualTo
panel_37 = Panel(larger_2.OrEqualTo)
bool_2 = Boolean(panel_37)
num_5 = Number(num_4)
cso = CreateSpeckleObject(A=crv, selectedKitName="Objects")
cso_2 = CreateSpeckleObject(B=scale.Geometry, selectedKitName="Objects")
cso_3 = CreateSpeckleObject(C=extrcrv_2, selectedKitName="Objects")
# https://macad.speckle.xyz/projects/28a211b286/models/4104f63f5f
cso_4 = CreateSpeckleObject(ColumnsCurves=cso, CrossSection=cso_2, Columns=cso_3, Loads=num_5, selectedKitName="Objects")
filter = StreamFilter(Gate=bool_2, Stream0=cso_3, Stream1=cso_4)
send = Send(
    Stream=panel_18,
    Data=filter,
    AutoSend=False,
    BaseId="77a876728550fc5c514dc1a3534e6a4b",
    CurrentComponentState="expired",
    KitName="Objects",
    OutputWrappers="https://macad.speckle.xyz\t7f5a70ef59\tc7cb06f117",
    UseDefaultCache=True,
    selectedKitName="Objects")
gate = StreamGate(Stream=filter, Gate=bool_2)  # -> Target0, Target1
panel_38 = Panel(gate.Target1)
cso_5 = CreateSpeckleObject(C=gate.Target0, selectedKitName="Objects")
# change "project" for "streams": https://macad.speckle.xyz/streams/a63c4e60ed
panel_39 = Panel("0a7a2c01a136ad89e2cfa5e002c9f1bcbe5656a1d0")
panel_40 = Panel("Receive_From_Compute Stream")
panel_41 = Panel("Bot Speckle Token")
txt_2 = Text()
sgetwt = StreamGetWithToken(Stream=txt_2, AuthToken=panel_39)
ss = SynchronousSender(
    Data=cso_5,
    Stream=sgetwt,
    OutputWrappers="https://macad.speckle.xyz\t27b32e7bd2\tab5404b2dc",
    UseDefaultCache=True,
    selectedKitName="Objects")

cso_6 = CreateSpeckleObject(A=curve, selectedKitName="Objects")
cso_7 = CreateSpeckleObject(B=rectangle.Rectangle, selectedKitName="Objects")
cso_8 = CreateSpeckleObject(C=extr, selectedKitName="Objects")
cso_9 = CreateSpeckleObject(ColumnsCurves=cso_6, CrossSection=cso_7, Columns=cso_8, Loads=num_2, selectedKitName="Objects")
panel_42 = Panel("https://macad.speckle.xyz/projects/7f5a70ef59/models/d62f789cfe")

receive_3 = Receive(
    Stream=panel_42,
    AutoReceive=True,
    CurrentComponentState="up_to_date",
    ExpandOutput=True,
    LastInfoMessage="ERVA Hofi @ 03/23/2025 00:14:14: Pushed 135011 elements from Grasshopper. (id:9d4832bd40)",
    ReceiveOnOpen=False,
    ReceivedCommitId="9d4832bd40",
    StreamWrapper="https://macad.speckle.xyz/projects/7f5a70ef59/models/structure 01",
    selectedKitName="Objects")  # -> Info, Data
filter_2 = StreamFilter(Gate=bool, Stream0=cso_8, Stream1=receive_3.Data)
gate_2 = StreamGate(Stream=filter_2, Gate=bool)  # -> Target0, Target1
dso_4 = DeconstructSpeckleObject(SpeckleObject=gate_2.Target1, selectedKitName="Objects")  # -> Columns, ColumnsCurves, CrossSection, Loads
cso_10 = CreateSpeckleObject(A=gate_2.Target1, selectedKitName="Objects")
dso_5 = DeconstructSpeckleObject(SpeckleObject=gate_2.Target1, selectedKitName="Objects")  # -> Columns, ColumnsCurves, CrossSection, Loads
panel_43 = Panel(cso_10)
panel_44 = Panel(dso_5.Columns)
panel_45 = Panel(dso_5.Loads)
dso_6 = DeconstructSpeckleObject(SpeckleObject=dso_5.CrossSection, selectedKitName="Objects")
dso_7 = DeconstructSpeckleObject(SpeckleObject=dso_5.ColumnsCurves, selectedKitName="Objects")
num_6 = Number(dso_5.Loads)
panel_46 = Panel(num_6)
crv_3 = Curve(dso_7)
panel_47 = Panel(crv_3)
num_7 = Number(dso_5.Loads)
crv_4 = Curve(dso_6)
area_4 = Area(Geometry=crv_4)  # -> Area, Centroid
panel_48 = Panel(area_4.Area)
scale_2 = Scale(Geometry=crv_4, Center=area_4.Centroid, Factor=Slider(1.1, range=0..10))  # -> Geometry, Transform
srf_4 = Surface(scale_2.Geometry)
area_5 = Area(Geometry=scale_2.Geometry)  # -> Area, Centroid
expression_5 = Expression(x=area_5.Area, Expression="sqrt(x)")
panel_49 = Panel(expression_5)
item_6 = ListItem(List=flatten(panel_49), Index="1", Wrap=True)
panel_50 = Panel(item_6)
multiplication_9 = Multiplication(A=expression_5, B=Slider(1, range=0..10))
multiplication_10 = Multiplication(A=multiplication_9, B="100")
rectangle_3 = Rectangle(Plane=crv_3, XSize=graft(panel_50), YSize=graft(panel_50), Radius=0)  # -> Rectangle, Length
srf_5 = Surface(rectangle_3.Rectangle)
expression_6 = Expression(P=num_7, L=multiplication_10, b=multiplication_9, E="20e9", Expression="(P * L) / (b^2 * E)")
panel_51 = Panel(multiplication_9)
extrcrv_3 = ExtrudeAlong(Base=srf_5, Curve=crv_3)
extrcrv_4 = ExtrudeAlong(Base=srf_4, Curve=crv_3)
volume_3 = Volume(Geometry=extrcrv_3)  # -> Volume, Centroid
panel_52 = Panel(expression_6)
panel_53 = Panel(area_5.Area)
volume_4 = Volume(Geometry=extrcrv_4)  # -> Volume, Centroid
panel_54 = Panel(volume_3.Volume)
ma_4 = MassAddition(Input=flatten(volume_3.Volume))  # -> Result, PartialResults
ma_5 = MassAddition(Input=flatten(volume_4.Volume))  # -> Result, PartialResults
panel_55 = Panel(volume_4.Volume)
panel_56 = Panel(ma_4.Result)
panel_57 = Panel(ma_5.Result)
multiplication_11 = Multiplication(A=panel_52, B="1000")
panel_58 = Panel(multiplication_11)
item_7 = ListItem(List=flatten(panel_58), Index="-1", Wrap=True)
division_3 = Division(A=panel_57, B=panel_56)

# ---- group: Displacement NO.
panel_59 = Panel(item_7)

# ----
panel_60 = Panel(division_3)
larger_3 = LargerThan(FirstNumber=panel_59, SecondNumber=panel_13)  # -> LargerThan, OrEqualTo
panel_61 = Panel(larger_3.OrEqualTo)
bool_3 = Boolean(panel_61)
num_8 = Number(num_7)
filter_3 = StreamFilter(Gate=bool, Stream0=cso_8, Stream1=cso_9)
gate_3 = StreamGate(Stream=filter_3, Gate=bool)  # -> Target0, Target1
expression_7 = Expression(F=bool, FunctionA=cso_9, Expression="If(F, FunctionA, FunctionB)")
expression_8 = Expression(T=bool, FunctionA=cso_9, Expression="If(T, FunctionA, FunctionB)")
cso_11 = CreateSpeckleObject(A=expression_8, selectedKitName="Objects")
panel_62 = Panel(gate_3.Target1)
cso_12 = CreateSpeckleObject(C=gate_3.Target0, selectedKitName="Objects")

send_2 = Send(
    Stream=panel_42,
    Data=gate_3.Target1,
    AutoSend=False,
    BaseId="a7ad54ac3ebf51cd9226b1f318b0aa45",
    CurrentComponentState="up_to_date",
    KitName="Objects",
    OutputWrappers="https://macad.speckle.xyz\t7f5a70ef59\t9d4832bd40",
    UseDefaultCache=True,
    selectedKitName="Objects")

# ----
# https://macad.speckle.xyz/projects/28a211b286/models/4104f63f5f
cso_13 = CreateSpeckleObject(A=crv_3, selectedKitName="Objects")
cso_14 = CreateSpeckleObject(B=scale_2.Geometry, selectedKitName="Objects")
cso_15 = CreateSpeckleObject(C=extrcrv_4, selectedKitName="Objects")
cso_16 = CreateSpeckleObject(ColumnsCurves=cso_13, CrossSection=cso_14, Columns=cso_15, Loads=num_8, selectedKitName="Objects")

filter_4 = StreamFilter(Gate=bool_3, Stream1=cso_16)
gate_4 = StreamGate(Stream=filter_4, Gate=bool_3)  # -> Target0, Target1

send_3 = Send(
    Stream=panel_19,
    Data=gate_4.Target1,
    AutoSend=True,
    BaseId="77a876728550fc5c514dc1a3534e6a4b",
    CurrentComponentState="up_to_date",
    KitName="Objects",
    OutputWrappers="https://macad.speckle.xyz\t7f5a70ef59\t67a9b2b9fe",
    UseDefaultCache=True,
    selectedKitName="Objects")

filter_5 = StreamFilter(Gate=bool_3, Stream0=cso_15, Stream1=cso_16)
gate_5 = StreamGate(Stream=filter_5, Gate=bool_3)  # -> Target0, Target1
panel_63 = Panel(gate_5.Target1)
