# Grasshopper definition floorplates.gh (Grasshopper 1.0.8)
# plug-ins: Speckle 2

# ---- group: floorplates
curve = Curve([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])
curve_2 = Curve([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])
list_item = ListItem(List=curve, Index=0, Wrap=True)  # -> Item1, Item
merge = Merge(Data1=curve_2, Data2=list_item.Item1)
panel = Panel("https://macad.speckle.xyz/projects/28a211b286/models/f5c0c919fa")
# Towers Structural System
send = Send(
    Stream=panel,
    Data=merge,
    AutoSend=False,
    BaseId="696ed7f514c0cd036ac3873a5d1df7f9",
    CurrentComponentState="up_to_date",
    KitName="Objects",
    OutputWrappers="https://macad.speckle.xyz\t28a211b286\tf6c21f573e",
    UseDefaultCache=True,
    selectedKitName="Objects")
