# Grasshopper definition speckle file.gh (Grasshopper 1.0.8)
# plug-ins: Speckle 2

# ---- group: floorplates
curve = Curve([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])
curve_2 = Curve([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])
list_item = ListItem(List=curve, Index=0, Wrap=True)  # -> Item1, Item
merge = Merge(Data1=curve_2, Data2=list_item.Item1)
panel = Panel("https://macad.speckle.xyz/projects/28a211b286/models/f5c0c919fa")
send = Send(
    Stream=panel,
    Data=merge,
    AutoSend=False,
    BaseId="696ed7f514c0cd036ac3873a5d1df7f9",
    CurrentComponentState="up_to_date",
    KitName="Objects",
    OutputWrappers="https://macad.speckle.xyz\t28a211b286\tbba7fa4c76",
    UseDefaultCache=True,
    selectedKitName="Objects")

# ----
panel_2 = Panel("https://macad.speckle.xyz/projects/28a211b286/models/f5c0c919fa")
receive = Receive(
    Stream=panel_2,
    AutoReceive=False,
    CurrentComponentState="up_to_date",
    ExpandOutput=True,
    LastInfoMessage="ERVA Hofi @ 03/17/2025 01:21:09: Pushed 50 elements from Grasshopper. (id:bba7fa4c76)",
    ReceiveOnOpen=False,
    ReceivedCommitId="bba7fa4c76",
    StreamWrapper="https://macad.speckle.xyz/projects/28a211b286/models/structure/towers/v4/floorplates",
    selectedKitName="Objects")  # -> Info, Data
panel_3 = Panel("https://macad.speckle.xyz/projects/28a211b286/models/f5c0c919fa")
receive_2 = Receive(
    Stream=panel_3,
    AutoReceive=False,
    CurrentComponentState="up_to_date",
    ExpandOutput=True,
    LastInfoMessage="ERVA Hofi @ 03/17/2025 01:21:09: Pushed 50 elements from Grasshopper. (id:bba7fa4c76)",
    ReceiveOnOpen=False,
    ReceivedCommitId="bba7fa4c76",
    StreamWrapper="https://macad.speckle.xyz/projects/28a211b286/models/structure/towers/v4/floorplates",
    selectedKitName="Objects")  # -> Info, Data
surface = Surface(graft(receive.Data))
radius_bottom = Slider(26, range=10..30)
of_columns_main_beams = Slider(10, range=0..30)
radius_top = Slider(16, range=10..20)
is_planar = IsPlanar(Surface=surface, Interior=True)  # -> Planar, Plane
project = Project(Geometry=surface, Plane=is_planar.Plane)  # -> Geometry, Transform

# ---- group: receive from 01
panel_4 = Panel("https://macad.speckle.xyz/projects/28a211b286/models/b2087feb78")
panel_5 = Panel("https://macad.speckle.xyz/projects/28a211b286/models/34e6ce27cc")
panel_6 = Panel("https://macad.speckle.xyz/projects/28a211b286/models/8a1073a17c")
receive_3 = Receive(
    Stream=panel_4,
    AutoReceive=False,
    CurrentComponentState="up_to_date",
    ExpandOutput=True,
    LastInfoMessage="ERVA Hofi @ 03/17/2025 01:31:28: Pushed 2 elements from Grasshopper. (id:942b97e903)",
    ReceiveOnOpen=False,
    ReceivedCommitId="942b97e903",
    StreamWrapper="https://macad.speckle.xyz/projects/28a211b286/models/structure/towers/v4/collab3",
    selectedKitName="Objects")  # -> Info, Loads
receive_4 = Receive(
    Stream=panel_6,
    AutoReceive=False,
    CurrentComponentState="up_to_date",
    ExpandOutput=True,
    LastInfoMessage="ERVA Hofi @ 03/17/2025 01:41:20: Pushed 482 elements from Grasshopper. (id:ebfee756f6)",
    ReceiveOnOpen=False,
    ReceivedCommitId="ebfee756f6",
    StreamWrapper="https://macad.speckle.xyz/projects/28a211b286/models/structure/towers/v4/collaborative",
    selectedKitName="Objects")  # -> Info, CrossSection
receive_5 = Receive(
    Stream=panel_5,
    AutoReceive=False,
    CurrentComponentState="up_to_date",
    ExpandOutput=True,
    LastInfoMessage="ERVA Hofi @ 03/17/2025 01:31:25: Pushed 482 elements from Grasshopper. (id:b18a782ba5)",
    ReceiveOnOpen=False,
    ReceivedCommitId="b18a782ba5",
    StreamWrapper="https://macad.speckle.xyz/projects/28a211b286/models/structure/towers/v4/collab2",
    selectedKitName="Objects")  # -> Info, BeamCurves

# ----
surface_2 = Surface(graft(receive_2.Data))
area = Area(Geometry=project.Geometry)  # -> Area, graft(Centroid)
is_planar_2 = IsPlanar(Surface=surface_2, Interior=True)  # -> Planar, Plane
radius_bottom_2 = Slider(26, range=10..30)
of_columns_main_beams_2 = Slider(10, range=0..30)
radius_top_2 = Slider(16, range=10..20)
project_2 = Project(Geometry=surface_2, Plane=is_planar_2.Plane)  # -> Geometry, Transform
# Towers Structural System
list_item_2 = ListItem(List=flatten(area.Centroid), Index=0, Wrap=True)  # -> Item1, Item
circle = Circle(Plane=list_item_2.Item1, Radius=radius_top)
circle_2 = Circle(Plane=list_item_2.Item, Radius=radius_bottom)
area_2 = Area(Geometry=project_2.Geometry)  # -> Area, graft(Centroid)
divide_curve = DivideCurve(Curve=circle, Count=of_columns_main_beams, Kinks=False)  # -> Points, Tangents, Parameters
divide_curve_2 = DivideCurve(Curve=circle_2, Count=of_columns_main_beams, Kinks=False)  # -> Points, Tangents, Parameters
deconstruct_brep = DeconstructBrep(Brep=project_2.Geometry)  # -> Faces, Edges, Vertices
point = Point(flatten(area_2.Centroid))
average = Average(Input=flatten(area_2.Area))
num = Number(receive_3.Loads)
deconstruct = Deconstruct(Point=point)  # -> XComponent, YComponent, ZComponent
list_item_3 = ListItem(List=flatten(area_2.Centroid), Index=0, Wrap=True)  # -> Item1, Item
line = Line(StartPoint=divide_curve.Points, EndPoint=divide_curve_2.Points)
curve_3 = Curve(deconstruct_brep.Faces)
sort_list = SortList(Keys=deconstruct.ZComponent, ValuesValuesA=point)  # -> Keys, ValuesValuesA
crv = Curve(receive_4.CrossSection)
multiplication = Multiplication(A=average, B=Slider(0.15, range=0.15..0.2))
surface_3 = Surface(flatten(surface))
circle_3 = Circle(Plane=area_2.Centroid, Radius=Slider(80, range=0..100))
circle_4 = Circle(Plane=list_item_3.Item1, Radius=radius_top_2)
circle_5 = Circle(Plane=list_item_3.Item, Radius=radius_bottom_2)
panel_7 = Panel("""0
-1""")
offset_curve = OffsetCurve(Curve=curve_3, Distance="-9", Corners=1)
expression = Expression(x=multiplication, Expression="sqrt((2 * x) / (3 * sqrt(3)))")
cull_index = CullIndex(List=surface_3, Indices=panel_7, Wrap=True)  # -> graft(List)
divide_curve_3 = DivideCurve(Curve=circle_3, Count=of_columns_main_beams_2, Kinks=False)  # -> Points, Tangents, Parameters
list_item_4 = ListItem(List=sort_list.ValuesValuesA, Index=0, Wrap=True)  # -> Item1, Item
split_with_breps = SplitWithBreps(Curve=line, Brep=flatten(cull_index))  # -> Curve, Points
divide_curve_4 = DivideCurve(Curve=circle_4, Count=of_columns_main_beams_2, Kinks=False)  # -> Points, Tangents, Parameters
divide_curve_5 = DivideCurve(Curve=circle_5, Count=of_columns_main_beams_2, Kinks=False)  # -> Points, Tangents, Parameters

panel_8 = Panel("https://macad.speckle.xyz/projects/28a211b286/models/49ac08c803")
panel_9 = Panel("https://macad.speckle.xyz/projects/28a211b286/models/b713bb2f52")
panel_10 = Panel("https://macad.speckle.xyz/projects/28a211b286/models/ca1b219383")
receive_6 = Receive(
    Stream=panel_10,
    AutoReceive=False,
    CurrentComponentState="up_to_date",
    ExpandOutput=True,
    LastInfoMessage="ERVA Hofi @ 03/17/2025 03:56:15: Pushed 472 elements from Grasshopper. (id:08f0720ce4)",
    ReceiveOnOpen=False,
    ReceivedCommitId="08f0720ce4",
    StreamWrapper="https://macad.speckle.xyz/projects/28a211b286/models/structure/towers/v4/columns-curves",
    selectedKitName="Objects")  # -> Info, ColumnsCurves
receive_7 = Receive(
    Stream=panel_8,
    AutoReceive=False,
    CurrentComponentState="up_to_date",
    ExpandOutput=True,
    LastInfoMessage="ERVA Hofi @ 03/17/2025 03:56:14: Pushed 472 elements from Grasshopper. (id:8f61e1a127)",
    ReceiveOnOpen=False,
    ReceivedCommitId="8f61e1a127",
    StreamWrapper="https://macad.speckle.xyz/projects/28a211b286/models/structure/towers/v4/columns-crosssection",
    selectedKitName="Objects")  # -> Info, CrossSection
receive_8 = Receive(
    Stream=panel_9,
    AutoReceive=False,
    CurrentComponentState="up_to_date",
    ExpandOutput=True,
    LastInfoMessage="ERVA Hofi @ 03/17/2025 03:56:16: Pushed 2 elements from Grasshopper. (id:47e7f026c5)",
    ReceiveOnOpen=False,
    ReceivedCommitId="47e7f026c5",
    StreamWrapper="https://macad.speckle.xyz/projects/28a211b286/models/structure/towers/v4/columns-loads",
    selectedKitName="Objects")  # -> Info, Loads

area_3 = Area(Geometry=crv)  # -> Area, Centroid
panel_11 = Panel(line)
line_2 = Line(StartPoint=list_item_4.Item, EndPoint=list_item_4.Item1)
scale = Scale(Geometry=crv, Center=area_3.Centroid, Factor=Slider(1.3, range=0..10))  # -> Geometry, Transform
line_3 = Line(StartPoint=area_2.Centroid, EndPoint=divide_curve_3.Points)
flip_matrix = FlipMatrix(Data=split_with_breps.Curve)
srf = Surface(scale.Geometry)
length = Length(Curve=line_2)
area_4 = Area(Geometry=scale.Geometry)  # -> Area, Centroid
expression_2 = Expression(x=area_4.Area, Expression="sqrt(x)")
panel_12 = Panel(expression_2)
item = ListItem(List=flatten(panel_12), Index="1", Wrap=True)
panel_13 = Panel(item)
multiplication_2 = Multiplication(A=expression_2, B=Slider(6, range=0..10))
multiplication_3 = Multiplication(A=multiplication_2, B="100")
rectangle = Rectangle(Plane=receive_5.BeamCurves, XSize=graft(panel_13), YSize=graft(panel_13), Radius=0)  # -> Rectangle, Length
srf_2 = Surface(rectangle.Rectangle)
expression_3 = Expression(P=num, L=multiplication_3, b=multiplication_2, E="20e9", Expression="(P * L) / (b^2 * E)")
panel_14 = Panel(multiplication_2)
extrcrv = ExtrudeAlong(Base=srf_2, Curve=receive_5.BeamCurves)
panel_15 = Panel(area_4.Area)
polygon = Polygon(Plane=list_item_4.Item, Radius=expression, Segments="5", FilletRadius=0)  # -> Polygon, Length
extrcrv_2 = ExtrudeAlong(Base=srf, Curve=receive_5.BeamCurves)
volume = Volume(Geometry=extrcrv)  # -> Volume, Centroid
line_4 = Line(StartPoint=divide_curve_4.Points, EndPoint=divide_curve_5.Points)
panel_16 = Panel(expression_3)
unit_z = UnitZ(Factor=length)
volume_2 = Volume(Geometry=extrcrv_2)  # -> Volume, Centroid
ma = MassAddition(Input=flatten(volume_2.Volume))  # -> Result, PartialResults
panel_17 = Panel(volume.Volume)
ma_2 = MassAddition(Input=flatten(volume.Volume))  # -> Result, PartialResults
surface_4 = Surface(flatten(surface_2))
curve_4 = Curve(flip_matrix)
panel_18 = Panel("""0
-1""")
series = Series(Start="1", Step=1, Count="47")
panel_19 = Panel(curve_4)
panel_20 = Panel(volume_2.Volume)
panel_21 = Panel(ma_2.Result)
panel_22 = Panel(ma.Result)
eval = Evaluate(F="3*((2+(N-2)*0.7)/N)", N=series)
cull_index_2 = CullIndex(List=surface_4, Indices=panel_18, Wrap=True)  # -> graft(List)
multiplication_4 = Multiplication(A=panel_16, B="1000")
crv_2 = Curve(receive_6.ColumnsCurves)
move = Move(Geometry=polygon.Polygon, Motion=unit_z)  # -> Geometry, Transform
ma_3 = MassAddition(Input=eval)  # -> Result, PartialResults
panel_23 = Panel(crv_2)
split_with_breps_2 = SplitWithBreps(Curve=line_4, Brep=flatten(cull_index_2))  # -> Curve, Points
panel_24 = Panel(multiplication_4)
total_load_kn = Panel(ma_3.Result)
sum_of_kn_floor = Panel(ma_3.PartialResults)
kn_floor = Panel(eval)
loft = Loft(
    Curves=[polygon.Polygon, move.Geometry],
    Options={Adjust=False, Closed=False, LoftEnds=0, LoftSimp=0, LoftType=0, Rebuild=10, Refit=0.01})
panel_25 = Panel(line_4)
flip_matrix_2 = FlipMatrix(Data=split_with_breps_2.Curve)
curve_5 = Curve(deconstruct_brep.Faces)
item_2 = ListItem(List=flatten(panel_24), Index="-1", Wrap=True)
cap_holes = CapHoles(Brep=loft)
panel_26 = Panel(sum_of_kn_floor)
brep_plane = BrepPlane(Brep=loft, Plane=flatten(is_planar_2.Plane))  # -> Curves, Points
project_3 = Project(Curve=line_3, Brep=curve_5, Direction=Vector(0, 0, 1))
division = Division(A=panel_22, B=panel_21)
num_2 = Number(receive_8.Loads)
panel_27 = Panel(item_2)
panel_28 = Panel(division)
trim_with_brep = TrimWithBrep(Curve=project_3, Brep=cap_holes)  # -> Inside, Outside
multiplication_5 = Multiplication(A=panel_26, B="10000")
curve_6 = Curve(trim_with_brep.Outside)
panel_29 = Panel(curve_6)
crv_3 = Curve(receive_7.CrossSection)
expression_4 = Expression(P=multiplication_5, Expression="Sqrt(P / (10^7))")
path_mapper = PathMapper(curve_6, source="{A;B;C;D;E;F}", target="{A;B}")
series_2 = Series(Start="1", Step=1, Count="47")
eval_2 = Evaluate(F="3*((2+(N-2)*0.7)/N)", N=series_2)
area_5 = Area(Geometry=crv_3)  # -> Area, Centroid
panel_30 = Panel(area_5.Area)
ma_4 = MassAddition(Input=eval_2)  # -> Result, PartialResults
panel_31 = Panel(expression_4)
panel_32 = Panel(path_mapper)
kn_floor_2 = Panel(eval_2)

# ---- group: final preview
cso = CreateSpeckleObject(BeamsCurves=receive_5.BeamCurves, selectedKitName="Objects")
cso_2 = CreateSpeckleObject(CrossSection=scale.Geometry, selectedKitName="Objects")
cso_3 = CreateSpeckleObject(Beams=extrcrv_2, selectedKitName="Objects")
panel_33 = Panel("https://macad.speckle.xyz/projects/28a211b286/models/df9f45a2fd")
cso_4 = CreateSpeckleObject(BeamsCurves=cso, CrossSection=cso_2, Beams=cso_3, selectedKitName="Objects")
send_2 = Send(
    Stream=panel_33,
    Data=cso_4,
    AutoSend=False,
    BaseId="03b12473f0fea4e5772781f6536ed7f8",
    CurrentComponentState="expired",
    KitName="Objects",
    OutputWrappers="https://macad.speckle.xyz\t28a211b286\t5b2c9e7492",
    UseDefaultCache=True,
    selectedKitName="Objects")

# ----
scale_2 = Scale(Geometry=crv_3, Center=area_5.Centroid, Factor=Slider(1.1, range=0..10))  # -> Geometry, Transform
srf_3 = Surface(scale_2.Geometry)
sum_of_kn_floor_2 = Panel(ma_4.PartialResults)
total_load_kn_2 = Panel(ma_4.Result)
len = Length(Curve=curve_4)

# ---- group: send 02 to recalculate 01
panel_34 = Panel("https://macad.speckle.xyz/projects/28a211b286/models/b2087feb78")
panel_35 = Panel("https://macad.speckle.xyz/projects/28a211b286/models/8a1073a17c")
panel_36 = Panel("https://macad.speckle.xyz/projects/28a211b286/models/34e6ce27cc")
send_3 = Send(
    Stream=panel_35,
    CrossSection=scale.Geometry,
    AutoSend=False,
    BaseId="1ab1fab8c6b584a54685f42cfd307821",
    CurrentComponentState="expired",
    KitName="Objects",
    OutputWrappers="https://macad.speckle.xyz\t28a211b286\t10240e5a1d",
    UseDefaultCache=True,
    selectedKitName="Objects")
send_4 = Send(
    Stream=panel_36,
    BeamCurves=receive_5.BeamCurves,
    AutoSend=False,
    BaseId="bb7fda96fbec7d4502b59cc5f0205eaf",
    CurrentComponentState="expired",
    KitName="Objects",
    OutputWrappers="https://macad.speckle.xyz\t28a211b286\tc7107b4d99",
    UseDefaultCache=True,
    selectedKitName="Objects")
send_5 = Send(
    Stream=panel_34,
    Loads=num,
    AutoSend=False,
    BaseId="fc1ea0ea36538d76637e82f9e114fada",
    CurrentComponentState="expired",
    KitName="Objects",
    OutputWrappers="https://macad.speckle.xyz\t28a211b286\t0d60ac672d",
    UseDefaultCache=True,
    selectedKitName="Objects")

# ----
area_6 = Area(Geometry=scale_2.Geometry)  # -> Area, Centroid
expression_5 = Expression(x=area_6.Area, Expression="sqrt(x)")
panel_37 = Panel(expression_5)
item_3 = ListItem(List=flatten(panel_37), Index="1", Wrap=True)
panel_38 = Panel(item_3)
multiplication_6 = Multiplication(A=expression_5, B=Slider(1, range=0..10))
multiplication_7 = Multiplication(A=multiplication_6, B="100")
rectangle_2 = Rectangle(Plane=crv_2, XSize=graft(panel_38), YSize=graft(panel_38), Radius=0)  # -> Rectangle, Length
srf_4 = Surface(rectangle_2.Rectangle)
expression_6 = Expression(P=num_2, L=multiplication_7, b=multiplication_6, E="20e9", Expression="(P * L) / (b^2 * E)")
panel_39 = Panel(multiplication_6)
extrcrv_3 = ExtrudeAlong(Base=srf_4, Curve=crv_2)
extrcrv_4 = ExtrudeAlong(Base=srf_3, Curve=crv_2)
volume_3 = Volume(Geometry=extrcrv_3)  # -> Volume, Centroid
item_4 = ListItem(List=len, Index=0, Wrap=True)
multiplication_8 = Multiplication(A=panel_31, B=Slider(2, range=0..10))
panel_40 = Panel(expression_6)
panel_41 = Panel(area_6.Area)
volume_4 = Volume(Geometry=extrcrv_4)  # -> Volume, Centroid
rectangle_3 = Rectangle(Plane=curve_4, XSize=graft(multiplication_8), YSize=graft(multiplication_8), Radius=0)  # -> Rectangle, Length
panel_42 = Panel(volume_3.Volume)
crv_4 = Curve(path_mapper)
ma_5 = MassAddition(Input=flatten(volume_3.Volume))  # -> Result, PartialResults
ma_6 = MassAddition(Input=flatten(volume_4.Volume))  # -> Result, PartialResults
neg = Negative(Value=item_4)
num_3 = Number(multiplication_5)
multiplication_9 = Multiplication(A=multiplication_8, B="100")
srf_5 = Surface(rectangle_3.Rectangle)
Z = UnitZ(Factor=neg)
panel_43 = Panel(volume_4.Volume)
panel_44 = Panel(ma_5.Result)
panel_45 = Panel(ma_6.Result)
multiplication_10 = Multiplication(A=panel_40, B="1000")
panel_46 = Panel(sum_of_kn_floor_2)
expression_7 = Expression(P=num_3, L=multiplication_9, b=multiplication_8, E="20e9", Expression="(P * L) / (b^2 * E)")
panel_47 = Panel(multiplication_8)
extr = Extrude(Base=srf_5, Direction=Z)
panel_48 = Panel(multiplication_10)
multiplication_11 = Multiplication(A=panel_46, B="10000")
panel_49 = Panel(multiplication_11)
panel_50 = Panel(expression_7)
# https://macad.speckle.xyz/projects/28a211b286/models/8a1073a17c
expression_8 = Expression(P=multiplication_11, Expression="Sqrt(P / (10^7))")
item_5 = ListItem(List=flatten(panel_48), Index="-1", Wrap=True)
division_2 = Division(A=panel_45, B=panel_44)
multiplication_12 = Multiplication(A=panel_50, B="1000")
panel_51 = Panel(expression_8)
rev = ReverseList(List=panel_51)
panel_52 = Panel(item_5)
panel_53 = Panel(division_2)
panel_54 = Panel(rev)
panel_55 = Panel(multiplication_12)
multiplication_13 = Multiplication(A=panel_54, B=Slider(6, range=0..10))
multiplication_14 = Multiplication(A=multiplication_13, B="100")
item_6 = ListItem(List=panel_55, Index="-1", Wrap=True)

cso_5 = CreateSpeckleObject(A=crv_2, selectedKitName="Objects")
cso_6 = CreateSpeckleObject(B=scale_2.Geometry, selectedKitName="Objects")
cso_7 = CreateSpeckleObject(C=extrcrv_4, selectedKitName="Objects")
panel_56 = Panel("https://macad.speckle.xyz/projects/28a211b286/models/4104f63f5f")
cso_8 = CreateSpeckleObject(ColumnsCurves=cso_5, CrossSection=cso_6, Columns=cso_7, selectedKitName="Objects")
send_6 = Send(
    Stream=panel_56,
    Data=cso_8,
    AutoSend=False,
    BaseId="1f6c6f671c6e5e539a30da8e28568537",
    CurrentComponentState="expired",
    KitName="Objects",
    OutputWrappers="https://macad.speckle.xyz\t28a211b286\tedbb6769d7",
    UseDefaultCache=True,
    selectedKitName="Objects")

num_4 = Number(multiplication_11)

panel_57 = Panel("https://macad.speckle.xyz/projects/28a211b286/models/b713bb2f52")
panel_58 = Panel("https://macad.speckle.xyz/projects/28a211b286/models/ca1b219383")
panel_59 = Panel("https://macad.speckle.xyz/projects/28a211b286/models/49ac08c803")
send_7 = Send(
    Stream=panel_58,
    ColumnsCurves=crv_2,
    AutoSend=False,
    BaseId="ecfe66b4995a9118c2ede15dce5f2a57",
    CurrentComponentState="expired",
    KitName="Objects",
    OutputWrappers="https://macad.speckle.xyz\t28a211b286\tafec437bbb",
    UseDefaultCache=True,
    selectedKitName="Objects")
send_8 = Send(
    Stream=panel_59,
    CrossSection=scale_2.Geometry,
    AutoSend=False,
    BaseId="b0df6c97333ae48531b73e89beb85a2c",
    CurrentComponentState="expired",
    KitName="Objects",
    OutputWrappers="https://macad.speckle.xyz\t28a211b286\t78ce8f24d8",
    UseDefaultCache=True,
    selectedKitName="Objects")
send_9 = Send(
    Stream=panel_57,
    Loads=num_2,
    AutoSend=False,
    BaseId="fc1ea0ea36538d76637e82f9e114fada",
    CurrentComponentState="expired",
    KitName="Objects",
    OutputWrappers="https://macad.speckle.xyz\t28a211b286\tc8c1252be2",
    UseDefaultCache=True,
    selectedKitName="Objects")

panel_60 = Panel(item_6)
num_5 = Number(multiplication_14)
expression_9 = Expression(P=num_4, L=multiplication_14, b=multiplication_13, E="20e9", Expression="(P * L) / (b^2 * E)")
panel_61 = Panel(multiplication_13)
multiplication_15 = Multiplication(A=panel_54, B=Slider(2, range=0..10))
item_7 = ListItem(List=multiplication_15, Index="1", Wrap=True)
panel_62 = Panel(item_7)
rectangle_4 = Rectangle(Plane=crv_4, XSize=graft(multiplication_15), YSize=graft(multiplication_15), Radius=0)  # -> Rectangle, Length
rectangle_5 = Rectangle(Plane=crv_4, XSize=graft(panel_62), YSize=graft(panel_62), Radius=0)  # -> Rectangle, Length
len_2 = Length(Curve=rectangle_4.Rectangle)
srf_6 = Surface(rectangle_4.Rectangle)
srf_7 = Surface(rectangle_5.Rectangle)
extrcrv_5 = ExtrudeAlong(Base=srf_6, Curve=crv_4)
extrcrv_6 = ExtrudeAlong(Base=srf_7, Curve=crv_4)
panel_63 = Panel(len_2)
volume_5 = Volume(Geometry=extrcrv_5)  # -> Volume, Centroid
volume_6 = Volume(Geometry=extrcrv_6)  # -> Volume, Centroid
panel_64 = Panel(volume_5.Volume)
panel_65 = Panel(expression_9)
ma_7 = MassAddition(Input=flatten(volume_5.Volume))  # -> Result, PartialResults
panel_66 = Panel(volume_6.Volume)
ma_8 = MassAddition(Input=flatten(volume_6.Volume))  # -> Result, PartialResults
expression_10 = Expression(x=panel_63, Expression="sqrt(x)")
panel_67 = Panel(multiplication_15)
panel_68 = Panel(ma_8.Result)

cso_9 = CreateSpeckleObject(A=curve_4, selectedKitName="Objects")
cso_10 = CreateSpeckleObject(B=rectangle_3.Rectangle, selectedKitName="Objects")
cso_11 = CreateSpeckleObject(C=extr, selectedKitName="Objects")
panel_69 = Panel("https://macad.speckle.xyz/projects/28a211b286/models/4104f63f5f")
cso_12 = CreateSpeckleObject(ColumnsCurves=cso_9, CrossSection=cso_10, Columns=cso_11, selectedKitName="Objects")
send_10 = Send(
    Stream=panel_69,
    Data=cso_12,
    AutoSend=False,
    BaseId="17d2769b87499ce1acec5f5e8e27556e",
    CurrentComponentState="up_to_date",
    KitName="Objects",
    OutputWrappers="https://macad.speckle.xyz\t28a211b286\t2f6f3bdaf6",
    UseDefaultCache=True,
    selectedKitName="Objects")

panel_70 = Panel(ma_7.Result)
panel_71 = Panel(expression_10)
multiplication_16 = Multiplication(A=panel_65, B="1000")

panel_72 = Panel("https://macad.speckle.xyz/projects/28a211b286/models/b713bb2f52")
panel_73 = Panel("https://macad.speckle.xyz/projects/28a211b286/models/ca1b219383")
panel_74 = Panel("https://macad.speckle.xyz/projects/28a211b286/models/49ac08c803")
send_11 = Send(
    Stream=panel_73,
    ColumnsCurves=curve_4,
    AutoSend=False,
    BaseId="ecfe66b4995a9118c2ede15dce5f2a57",
    CurrentComponentState="up_to_date",
    KitName="Objects",
    OutputWrappers="https://macad.speckle.xyz\t28a211b286\t08f0720ce4",
    UseDefaultCache=True,
    selectedKitName="Objects")
send_12 = Send(
    Stream=panel_74,
    CrossSection=rectangle_3.Rectangle,
    AutoSend=False,
    BaseId="354292fd2e46af7f2ae0c8d2097276ca",
    CurrentComponentState="up_to_date",
    KitName="Objects",
    OutputWrappers="https://macad.speckle.xyz\t28a211b286\t8f61e1a127",
    UseDefaultCache=True,
    selectedKitName="Objects")
send_13 = Send(
    Stream=panel_72,
    Loads=multiplication_5,
    AutoSend=False,
    BaseId="fc1ea0ea36538d76637e82f9e114fada",
    CurrentComponentState="up_to_date",
    KitName="Objects",
    OutputWrappers="https://macad.speckle.xyz\t28a211b286\t47e7f026c5",
    UseDefaultCache=True,
    selectedKitName="Objects")

panel_75 = Panel(multiplication_16)
division_3 = Division(A=panel_70, B=panel_68)
panel_76 = Panel(division_3)
item_8 = ListItem(List=panel_75, Index="-1", Wrap=True)
panel_77 = Panel(item_8)

# ---- group: send to residential team
cso_13 = CreateSpeckleObject(BeamsCurves=crv_4, selectedKitName="Objects")
cso_14 = CreateSpeckleObject(CrossSection=rectangle_4.Rectangle, selectedKitName="Objects")
cso_15 = CreateSpeckleObject(Beams=extrcrv_5, selectedKitName="Objects")
panel_78 = Panel("https://macad.speckle.xyz/projects/28a211b286/models/df9f45a2fd")
cso_16 = CreateSpeckleObject(BeamsCurves=cso_13, CrossSection=cso_14, Beams=cso_15, selectedKitName="Objects")
send_14 = Send(
    Stream=panel_78,
    Data=cso_16,
    AutoSend=False,
    BaseId="fa1929618e51fbfde9a586fe08a27a68",
    CurrentComponentState="up_to_date",
    KitName="Objects",
    OutputWrappers="https://macad.speckle.xyz\t28a211b286\tacc7844033",
    UseDefaultCache=True,
    selectedKitName="Objects")

# ---- group: sned01to02
panel_79 = Panel("https://macad.speckle.xyz/projects/28a211b286/models/b2087feb78")
panel_80 = Panel("https://macad.speckle.xyz/projects/28a211b286/models/8a1073a17c")
panel_81 = Panel("https://macad.speckle.xyz/projects/28a211b286/models/34e6ce27cc")
send_15 = Send(
    Stream=panel_80,
    CrossSection=rectangle_4.Rectangle,
    AutoSend=False,
    BaseId="9ae0219535929de476ef460e44ed4176",
    CurrentComponentState="up_to_date",
    KitName="Objects",
    OutputWrappers="https://macad.speckle.xyz\t28a211b286\t259a1552c6",
    UseDefaultCache=True,
    selectedKitName="Objects")
send_16 = Send(
    Stream=panel_81,
    BeamCurves=crv_4,
    AutoSend=False,
    BaseId="0b3e0153cdbf13270133ef335268fee3",
    CurrentComponentState="up_to_date",
    KitName="Objects",
    OutputWrappers="https://macad.speckle.xyz\t28a211b286\tb18a782ba5",
    UseDefaultCache=True,
    selectedKitName="Objects")
send_17 = Send(
    Stream=panel_79,
    Loads=multiplication_11,
    AutoSend=False,
    BaseId="fc1ea0ea36538d76637e82f9e114fada",
    CurrentComponentState="up_to_date",
    KitName="Objects",
    OutputWrappers="https://macad.speckle.xyz\t28a211b286\t942b97e903",
    UseDefaultCache=True,
    selectedKitName="Objects")
